# Grasshopper definition envelope.gh (Grasshopper 0.9.76)

crv = Curve(<curve referenced from the Rhino model>)
crv_2 = Curve(<curve referenced from the Rhino model>)
crv_3 = Curve(<curve referenced from the Rhino model>)
crv_4 = Curve(<curve referenced from the Rhino model>)
crv_5 = Curve(<curve referenced from the Rhino model>)
crv_6 = Curve(<curve referenced from the Rhino model>)
pframes = PerpFrames(Curve=crv, Count=1, Align=True)  # -> Frames, Parameters
crv_7 = Curve(<curve referenced from the Rhino model>)
crv_8 = Curve(<curve referenced from the Rhino model>)
crv_9 = Curve(<curve referenced from the Rhino model>)
pframes_2 = PerpFrames(Curve=crv_3, Count=1, Align=True)  # -> Frames, Parameters
pframes_3 = PerpFrames(Curve=crv_2, Count=1, Align=True)  # -> Frames, Parameters
pframes_4 = PerpFrames(Curve=crv_4, Count=1, Align=True)  # -> Frames, Parameters
pframes_5 = PerpFrames(Curve=crv_6, Count=1, Align=True)  # -> Frames, Parameters
pframes_6 = PerpFrames(Curve=crv_5, Count=1, Align=True)  # -> Frames, Parameters
pframes_7 = PerpFrames(Curve=crv_7, Count=1, Align=True)  # -> Frames, Parameters
pframes_8 = PerpFrames(Curve=crv_8, Count=1, Align=True)  # -> Frames, Parameters
pframes_9 = PerpFrames(Curve=crv_9, Count=1, Align=True)  # -> Frames, Parameters
deplane = DeconstructPlane(Plane=pframes.Frames)  # -> Origin, XAxis, YAxis, ZAxis
Z = UnitZ(Factor=1)
Z_2 = UnitZ(Factor=1)
Z_3 = UnitZ(Factor=1)
Z_4 = UnitZ(Factor=1)
Z_5 = UnitZ(Factor=1)
Z_6 = UnitZ(Factor=1)
Z_7 = UnitZ(Factor=1)
deplane_2 = DeconstructPlane(Plane=pframes_2.Frames)  # -> Origin, XAxis, YAxis, ZAxis
Z_8 = UnitZ(Factor=1)
Z_9 = UnitZ(Factor=1)
deplane_3 = DeconstructPlane(Plane=pframes_3.Frames)  # -> Origin, XAxis, YAxis, ZAxis
deplane_4 = DeconstructPlane(Plane=pframes_4.Frames)  # -> Origin, XAxis, YAxis, ZAxis
deplane_5 = DeconstructPlane(Plane=pframes_5.Frames)  # -> Origin, XAxis, YAxis, ZAxis
deplane_6 = DeconstructPlane(Plane=pframes_6.Frames)  # -> Origin, XAxis, YAxis, ZAxis
angle = Angle(VectorA=deplane_2.YAxis, VectorB=Z)  # -> Angle, Reflex
deplane_7 = DeconstructPlane(Plane=pframes_7.Frames)  # -> Origin, XAxis, YAxis, ZAxis
angle_2 = Angle(VectorA=deplane.YAxis, VectorB=Z_2)  # -> Angle, Reflex
angle_3 = Angle(VectorA=deplane_3.YAxis, VectorB=Z_3)  # -> Angle, Reflex
angle_4 = Angle(VectorA=deplane_4.YAxis, VectorB=Z_4)  # -> Angle, Reflex
deplane_8 = DeconstructPlane(Plane=pframes_8.Frames)  # -> Origin, XAxis, YAxis, ZAxis
deplane_9 = DeconstructPlane(Plane=pframes_9.Frames)  # -> Origin, XAxis, YAxis, ZAxis
angle_5 = Angle(VectorA=deplane_5.YAxis, VectorB=Z_5)  # -> Angle, Reflex
angle_6 = Angle(VectorA=deplane_6.YAxis, VectorB=Z_6)  # -> Angle, Reflex
angle_7 = Angle(VectorA=deplane_7.YAxis, VectorB=Z_7)  # -> Angle, Reflex
angle_8 = Angle(VectorA=deplane_8.YAxis, VectorB=Z_8)  # -> Angle, Reflex
angle_9 = Angle(VectorA=deplane_9.YAxis, VectorB=Z_9)  # -> Angle, Reflex
neg = Negative(Value=angle.Angle)
neg_2 = Negative(Value=angle_3.Angle)
neg_3 = Negative(Value=angle_4.Angle)
neg_4 = Negative(Value=angle_2.Angle)
prot = RotatePlane(Plane=pframes_2.Frames, Angle=neg)
prot_2 = RotatePlane(Plane=pframes_3.Frames, Angle=neg_2)
neg_5 = Negative(Value=angle_5.Angle)
neg_6 = Negative(Value=angle_6.Angle)
neg_7 = Negative(Value=angle_7.Angle)
neg_8 = Negative(Value=angle_8.Angle)
neg_9 = Negative(Value=angle_9.Angle)
prot_3 = RotatePlane(Plane=pframes.Frames, Angle=neg_4)
prot_4 = RotatePlane(Plane=pframes_4.Frames, Angle=neg_3)
deplane_10 = DeconstructPlane(Plane=prot)  # -> Origin, XAxis, YAxis, ZAxis
deplane_11 = DeconstructPlane(Plane=prot_3)  # -> Origin, XAxis, YAxis, ZAxis
deplane_12 = DeconstructPlane(Plane=prot_2)  # -> Origin, XAxis, YAxis, ZAxis
prot_5 = RotatePlane(Plane=pframes_5.Frames, Angle=neg_5)
prot_6 = RotatePlane(Plane=pframes_6.Frames, Angle=neg_6)
prot_7 = RotatePlane(Plane=pframes_7.Frames, Angle=neg_7)
prot_8 = RotatePlane(Plane=pframes_8.Frames, Angle=neg_8)
prot_9 = RotatePlane(Plane=pframes_9.Frames, Angle=neg_9)
deplane_13 = DeconstructPlane(Plane=prot_5)  # -> Origin, XAxis, YAxis, ZAxis
deplane_14 = DeconstructPlane(Plane=prot_7)  # -> Origin, XAxis, YAxis, ZAxis
deplane_15 = DeconstructPlane(Plane=prot_8)  # -> Origin, XAxis, YAxis, ZAxis
deplane_16 = DeconstructPlane(Plane=prot_9)  # -> Origin, XAxis, YAxis, ZAxis
move = Move(Geometry=deplane_10.Origin, Motion=deplane_10.YAxis)  # -> Geometry, Transform
move_2 = Move(Geometry=deplane_11.Origin, Motion=deplane_11.YAxis)  # -> Geometry, Transform
move_3 = Move(Geometry=deplane_12.Origin, Motion=deplane_12.YAxis)  # -> Geometry, Transform
move_4 = Move(Geometry=deplane_13.Origin, Motion=deplane_13.YAxis)  # -> Geometry, Transform
move_5 = Move(Geometry=deplane_14.Origin, Motion=deplane_14.YAxis)  # -> Geometry, Transform
move_6 = Move(Geometry=deplane_15.Origin, Motion=deplane_15.YAxis)  # -> Geometry, Transform
move_7 = Move(Geometry=deplane_16.Origin, Motion=deplane_16.YAxis)  # -> Geometry, Transform
ln = Line(StartPoint=deplane_10.Origin, EndPoint=move.Geometry)
ln_2 = Line(StartPoint=deplane_11.Origin, EndPoint=move_2.Geometry)
rotax = RotateAxis(Geometry=prot_3, Angle=3.141592654, Axis=ln_2)  # -> Geometry, Transform
ln_3 = Line(StartPoint=deplane_12.Origin, EndPoint=move_3.Geometry)
ln_4 = Line(StartPoint=deplane_13.Origin, EndPoint=move_4.Geometry)
ln_5 = Line(StartPoint=deplane_14.Origin, EndPoint=move_5.Geometry)
rotax_2 = RotateAxis(Geometry=prot, Angle=3.141592654, Axis=ln)  # -> Geometry, Transform
ln_6 = Line(StartPoint=deplane_15.Origin, EndPoint=move_6.Geometry)
ln_7 = Line(StartPoint=deplane_16.Origin, EndPoint=move_7.Geometry)
rotax_3 = RotateAxis(Geometry=prot_2, Angle=3.141592654, Axis=ln_3)  # -> Geometry, Transform
rotax_4 = RotateAxis(Geometry=prot_5, Angle=3.141592654, Axis=ln_4)  # -> Geometry, Transform
item = ListItem(List=rotax.Geometry, Index=0, Wrap=True)  # -> flatten(Item)
rotax_5 = RotateAxis(Geometry=prot_7, Angle=3.141592654, Axis=ln_5)  # -> Geometry, Transform
item_2 = ListItem(List=rotax.Geometry, Index=1, Wrap=True)  # -> flatten(Item)
rotax_6 = RotateAxis(Geometry=prot_8, Angle=3.141592654, Axis=ln_6)  # -> Geometry, Transform
rotax_7 = RotateAxis(Geometry=prot_9, Angle=3.141592654, Axis=ln_7)  # -> Geometry, Transform
item_3 = ListItem(List=rotax_2.Geometry, Index=0, Wrap=True)  # -> flatten(Item)
item_4 = ListItem(List=rotax_2.Geometry, Index=1, Wrap=True)  # -> flatten(Item)
item_5 = ListItem(List=rotax_3.Geometry, Index=0, Wrap=True)  # -> flatten(Item)
item_6 = ListItem(List=rotax_3.Geometry, Index=1, Wrap=True)  # -> flatten(Item)
item_7 = ListItem(List=prot_4, Index=0, Wrap=True)  # -> flatten(Item)
item_8 = ListItem(List=prot_4, Index=1, Wrap=True)  # -> flatten(Item)
item_9 = ListItem(List=rotax_4.Geometry, Index=0, Wrap=True)  # -> flatten(Item)
item_10 = ListItem(List=rotax_4.Geometry, Index=1, Wrap=True)  # -> flatten(Item)
item_11 = ListItem(List=prot_6, Index=0, Wrap=True)  # -> flatten(Item)
item_12 = ListItem(List=prot_6, Index=1, Wrap=True)  # -> flatten(Item)
item_13 = ListItem(List=rotax_5.Geometry, Index=0, Wrap=True)  # -> flatten(Item)
item_14 = ListItem(List=rotax_5.Geometry, Index=1, Wrap=True)  # -> flatten(Item)
cant = Slider(0, range=0..100)
item_15 = ListItem(List=rotax_6.Geometry, Index=0, Wrap=True)  # -> flatten(Item)
item_16 = ListItem(List=rotax_7.Geometry, Index=0, Wrap=True)  # -> flatten(Item)
cant_2 = Slider(0, range=0..100)
item_17 = ListItem(List=rotax_6.Geometry, Index=1, Wrap=True)  # -> flatten(Item)
item_18 = ListItem(List=rotax_7.Geometry, Index=1, Wrap=True)  # -> flatten(Item)
cant_3 = Slider(25, range=0..100)
cant_4 = Slider(25, range=0..100)
cant_5 = Slider(0, range=0..100)
cant_6 = Slider(0, range=0..100)
cant_7 = Slider(10, range=0..100)
cant_8 = Slider(10, range=0..100)
cant_9 = Slider(0, range=0..100)
cant_10 = Slider(0, range=0..100)
cluster = Cluster(cant=cant_2, R=Slider(0, range=-10000..10000))  # -> arc_env, car_env
cluster_2 = Cluster(cant=cant, R=Slider(0, range=-10000..10000))  # -> arc_env, car_env
cluster_3 = Cluster(cant=cant_3, R=Slider(-500, range=-10000..10000))  # -> arc_env, car_env
cluster_4 = Cluster(cant=cant_4, R=Slider(-500, range=-10000..10000))  # -> arc_env, car_env
cluster_5 = Cluster(cant=cant_5, R=Slider(0, range=-10000..10000))  # -> arc_env, car_env
cluster_6 = Cluster(cant=cant_6, R=Slider(0, range=-10000..10000))  # -> arc_env, car_env
cluster_7 = Cluster(cant=cant_7, R=Slider(-1250, range=-10000..10000))  # -> arc_env, car_env
cluster_8 = Cluster(cant=cant_8, R=Slider(-1250, range=-10000..10000))  # -> arc_env, car_env
cluster_9 = Cluster(cant=cant_9, R=Slider(0, range=-10000..10000))  # -> arc_env, car_env
cluster_10 = Cluster(cant=cant_10, R=Slider(0, range=-10000..10000))  # -> arc_env, car_env
orient = Orient(Geometry=cluster.arc_env, Source=PlaneXY(0, 0, 0), Target=item)  # -> Geometry, Transform
orient_2 = Orient(Geometry=cluster_3.car_env, Source=PlaneXY(0, 0, 0), Target=item_4)  # -> Geometry, Transform
orient_3 = Orient(Geometry=cluster_3.arc_env, Source=PlaneXY(0, 0, 0), Target=item_4)  # -> Geometry, Transform
orient_4 = Orient(Geometry=cluster.car_env, Source=PlaneXY(0, 0, 0), Target=item)  # -> Geometry, Transform
orient_5 = Orient(Geometry=cluster_2.car_env, Source=PlaneXY(0, 0, 0), Target=item_2)  # -> Geometry, Transform
orient_6 = Orient(Geometry=cluster_2.arc_env, Source=PlaneXY(0, 0, 0), Target=item_2)  # -> Geometry, Transform
orient_7 = Orient(Geometry=cluster_4.car_env, Source=PlaneXY(0, 0, 0), Target=item_6)  # -> Geometry, Transform
orient_8 = Orient(Geometry=cluster_4.arc_env, Source=PlaneXY(0, 0, 0), Target=item_6)  # -> Geometry, Transform
orient_9 = Orient(Geometry=cluster_5.car_env, Source=PlaneXY(0, 0, 0), Target=item_7)  # -> Geometry, Transform
orient_10 = Orient(Geometry=cluster_5.arc_env, Source=PlaneXY(0, 0, 0), Target=item_7)  # -> Geometry, Transform
orient_11 = Orient(Geometry=cluster_6.car_env, Source=PlaneXY(0, 0, 0), Target=item_10)  # -> Geometry, Transform
orient_12 = Orient(Geometry=cluster_6.arc_env, Source=PlaneXY(0, 0, 0), Target=item_10)  # -> Geometry, Transform
orient_13 = Orient(Geometry=cluster_7.car_env, Source=PlaneXY(0, 0, 0), Target=item_11)  # -> Geometry, Transform
orient_14 = Orient(Geometry=cluster_7.arc_env, Source=PlaneXY(0, 0, 0), Target=item_11)  # -> Geometry, Transform
orient_15 = Orient(Geometry=cluster_8.car_env, Source=PlaneXY(0, 0, 0), Target=item_14)  # -> Geometry, Transform
orient_16 = Orient(Geometry=cluster_8.arc_env, Source=PlaneXY(0, 0, 0), Target=item_14)  # -> Geometry, Transform
orient_17 = Orient(Geometry=cluster_9.car_env, Source=PlaneXY(0, 0, 0), Target=item_17)  # -> Geometry, Transform
orient_18 = Orient(Geometry=cluster_10.car_env, Source=PlaneXY(0, 0, 0), Target=item_18)  # -> Geometry, Transform
orient_19 = Orient(Geometry=cluster_9.arc_env, Source=PlaneXY(0, 0, 0), Target=item_17)  # -> Geometry, Transform
orient_20 = Orient(Geometry=cluster_10.arc_env, Source=PlaneXY(0, 0, 0), Target=item_18)  # -> Geometry, Transform
swp1 = Sweep1(Rail=crv, Sections=[orient.Geometry, orient_6.Geometry], Miter=1)
swp1_2 = Sweep1(Rail=crv, Sections=[orient_4.Geometry, orient_5.Geometry], Miter=1)
swp1_3 = Sweep1(Rail=crv_2, Sections=[orient_6.Geometry, orient_8.Geometry], Miter=1)
swp1_4 = Sweep1(Rail=crv_2, Sections=[orient_5.Geometry, orient_7.Geometry], Miter=1)
swp1_5 = Sweep1(Rail=crv_3, Sections=[orient_8.Geometry, orient_3.Geometry], Miter=1)
swp1_6 = Sweep1(Rail=crv_3, Sections=[orient_7.Geometry, orient_2.Geometry], Miter=1)
swp1_7 = Sweep1(Rail=crv_4, Sections=[orient_3.Geometry, orient_10.Geometry], Miter=1)
swp1_8 = Sweep1(Rail=crv_4, Sections=[orient_2.Geometry, orient_9.Geometry], Miter=1)
swp1_9 = Sweep1(Rail=crv_6, Sections=[orient_10.Geometry, orient_12.Geometry], Miter=1)
swp1_10 = Sweep1(Rail=crv_6, Sections=[orient_9.Geometry, orient_11.Geometry], Miter=1)
swp1_11 = Sweep1(Rail=crv_5, Sections=[orient_12.Geometry, orient_14.Geometry], Miter=1)
swp1_12 = Sweep1(Rail=crv_5, Sections=[orient_11.Geometry, orient_13.Geometry], Miter=1)
swp1_13 = Sweep1(Rail=crv_7, Sections=[orient_14.Geometry, orient_16.Geometry], Miter=1)
swp1_14 = Sweep1(Rail=crv_7, Sections=[orient_13.Geometry, orient_15.Geometry], Miter=1)
swp1_15 = Sweep1(Rail=crv_8, Sections=[orient_16.Geometry, orient_19.Geometry], Miter=1)
swp1_16 = Sweep1(Rail=crv_8, Sections=[orient_15.Geometry, orient_17.Geometry], Miter=1)
swp1_17 = Sweep1(Rail=crv_9, Sections=[orient_19.Geometry, orient_20.Geometry], Miter=1)
swp1_18 = Sweep1(Rail=crv_9, Sections=[orient_17.Geometry, orient_18.Geometry], Miter=1)

# ==== cluster Cluster
number_slider = Slider(-500, range=-10000..10000)
R = ClusterInput()  # Radius
num = Number(R)
abs = Absolute(Value=num)
expression = Expression(x=abs, y="24500", Expression="if(x=0, 0, y/x)")
addition = Addition(A=expression, B="1135")
addition_2 = Addition(A=expression, B="1210")
addition_3 = Addition(A=expression, B="1515")
addition_4 = Addition(A=expression, B="1555")
addition_5 = Addition(A=expression, B="1900")
addition_6 = Addition(A=expression, B="1900")
addition_7 = Addition(A=expression, B="1440")
addition_8 = Addition(A=expression, B="1440")
addition_9 = Addition(A=expression, B="1500")
addition_10 = Addition(A=expression, B="1500")
pt = ConstructPoint(XCoordinate=0, YCoordinate=0, ZCoordinate=0)
vec = VectorXYZ(XComponent="1900", YComponent="3356.47", ZComponent=0)  # -> Vector, Length
vec_2 = VectorXYZ(XComponent=addition_3, YComponent="305", ZComponent=0)  # -> Vector, Length
vec_3 = VectorXYZ(XComponent=addition_4, YComponent="1050", ZComponent=0)  # -> Vector, Length
vec_4 = VectorXYZ(XComponent=addition_5, YComponent="1050", ZComponent=0)  # -> Vector, Length
vec_5 = VectorXYZ(XComponent=addition_6, YComponent="3356.47", ZComponent=0)  # -> Vector, Length
vec_6 = VectorXYZ(XComponent="0", YComponent="4500", ZComponent=0)  # -> Vector, Length
X = UnitX(Factor=addition_2)
vec_7 = VectorXYZ(XComponent=addition, YComponent="75", ZComponent=0)  # -> Vector, Length
vec_8 = VectorXYZ(XComponent=addition_7, YComponent="355", ZComponent=0)  # -> Vector, Length
vec_9 = VectorXYZ(XComponent=addition_8, YComponent="965", ZComponent=0)  # -> Vector, Length
vec_10 = VectorXYZ(XComponent=addition_9, YComponent="965", ZComponent=0)  # -> Vector, Length
vec_11 = VectorXYZ(XComponent=addition_10, YComponent="3333.09", ZComponent=0)  # -> Vector, Length
vec_12 = VectorXYZ(XComponent="1500", YComponent="3333.09", ZComponent=0)  # -> Vector, Length
vec_13 = VectorXYZ(XComponent=0, YComponent="4100", ZComponent=0)  # -> Vector, Length
move = Move(Geometry=pt, Motion=vec.Vector)  # -> Geometry, Transform
move_2 = Move(Geometry=pt, Motion=vec_6.Vector)  # -> Geometry, Transform
move_3 = Move(Geometry=pt, Motion=X)  # -> Geometry, Transform
move_4 = Move(Geometry=pt, Motion=vec_2.Vector)  # -> Geometry, Transform
move_5 = Move(Geometry=pt, Motion=vec_3.Vector)  # -> Geometry, Transform
move_6 = Move(Geometry=pt, Motion=vec_4.Vector)  # -> Geometry, Transform
move_7 = Move(Geometry=pt, Motion=vec_5.Vector)  # -> Geometry, Transform
move_8 = Move(Geometry=pt, Motion=vec_7.Vector)  # -> Geometry, Transform
move_9 = Move(Geometry=pt, Motion=vec_8.Vector)  # -> Geometry, Transform
move_10 = Move(Geometry=pt, Motion=vec_9.Vector)  # -> Geometry, Transform
move_11 = Move(Geometry=pt, Motion=vec_10.Vector)  # -> Geometry, Transform
move_12 = Move(Geometry=pt, Motion=vec_11.Vector)  # -> Geometry, Transform
move_13 = Move(Geometry=pt, Motion=vec_12.Vector)  # -> Geometry, Transform
move_14 = Move(Geometry=pt, Motion=vec_13.Vector)  # -> Geometry, Transform
mirror = Mirror(Geometry=move.Geometry, Plane=PlaneYZ(0, 0, 0))  # -> Geometry, Transform
mirror_2 = Mirror(Geometry=move_3.Geometry, Plane=PlaneYZ(0, 0, 0))  # -> Geometry, Transform
mirror_3 = Mirror(Geometry=move_4.Geometry, Plane=PlaneYZ(0, 0, 0))  # -> Geometry, Transform
mirror_4 = Mirror(Geometry=move_5.Geometry, Plane=PlaneYZ(0, 0, 0))  # -> Geometry, Transform
mirror_5 = Mirror(Geometry=move_6.Geometry, Plane=PlaneYZ(0, 0, 0))  # -> Geometry, Transform
mirror_6 = Mirror(Geometry=move_7.Geometry, Plane=PlaneYZ(0, 0, 0))  # -> Geometry, Transform
mirror_7 = Mirror(Geometry=move_8.Geometry, Plane=PlaneYZ(0, 0, 0))  # -> Geometry, Transform
mirror_8 = Mirror(Geometry=move_9.Geometry, Plane=PlaneYZ(0, 0, 0))  # -> Geometry, Transform
mirror_9 = Mirror(Geometry=move_10.Geometry, Plane=PlaneYZ(0, 0, 0))  # -> Geometry, Transform
mirror_10 = Mirror(Geometry=move_11.Geometry, Plane=PlaneYZ(0, 0, 0))  # -> Geometry, Transform
mirror_11 = Mirror(Geometry=move_12.Geometry, Plane=PlaneYZ(0, 0, 0))  # -> Geometry, Transform
mirror_12 = Mirror(Geometry=move_13.Geometry, Plane=PlaneYZ(0, 0, 0))  # -> Geometry, Transform
division = Division(A="1067", B="2")
pline = PolyLine(
    Vertices=[mirror.Geometry, mirror_6.Geometry, mirror_5.Geometry, mirror_4.Geometry, mirror_3.Geometry, mirror_2.Geometry, move_3.Geometry, move_4.Geometry, move_5.Geometry, move_6.Geometry, move_7.Geometry, move.Geometry],
    Closed=False)
arc = Arc3Pt(PointA=move.Geometry, PointB=move_2.Geometry, PointC=mirror.Geometry)  # -> Arc, Plane, Radius
X_2 = UnitX(Factor=division)
pline_2 = PolyLine(
    Vertices=[mirror_12.Geometry, mirror_11.Geometry, mirror_10.Geometry, mirror_9.Geometry, mirror_8.Geometry, mirror_7.Geometry, move_8.Geometry, move_9.Geometry, move_10.Geometry, move_11.Geometry, move_12.Geometry, move_13.Geometry],
    Closed=False)
arc_2 = Arc3Pt(PointA=move_13.Geometry, PointB=move_14.Geometry, PointC=mirror_12.Geometry)  # -> Arc, Plane, Radius
move_15 = Move(Geometry=pt, Motion=X_2)  # -> Geometry, Transform
mirror_13 = Mirror(Geometry=move_15.Geometry, Plane=PlaneYZ(0, 0, 0))  # -> Geometry, Transform
vec2pt = Vector2Pt(PointA=mirror_13.Geometry, PointB=move_15.Geometry, Unitize=False)  # -> Vector, Length
超高 = Slider(25, range=0..100)
cant = ClusterInput()  # cant
devec = DeconstructVector(Vector=vec2pt.Vector)  # -> XComponent, YComponent, ZComponent
num_2 = Number(cant)
expression_2 = Expression(x=R, Expression="if(x>0,1,0)")
vec_14 = VectorXYZ(XComponent=devec.XComponent, YComponent=num_2, ZComponent=0)  # -> Vector, Length
angle = Angle(VectorA=vec2pt.Vector, VectorB=vec_14.Vector)  # -> Angle, Reflex
join = JoinCurves(Curves=[pline, arc.Arc], Preserve=False)
join_2 = JoinCurves(Curves=[pline_2, arc_2.Arc], Preserve=False)
expression_3 = Expression(x=R, y=angle.Angle, Expression="if(x>0,-y,y)")
item = ListItem(List=[mirror_13.Geometry, move_15.Geometry], Index=expression_2, Wrap=True)
rot3d = Rotate3D(Geometry=join, Angle=expression_3, Center=item, Axis=Vector(0, 0, 1))  # -> Geometry, Transform
rot3d_2 = Rotate3D(Geometry=join_2, Angle=expression_3, Center=item, Axis=Vector(0, 0, 1))  # -> Geometry, Transform
arc_env = ClusterOutput(rot3d.Geometry)  # Arc-Env
car_env = ClusterOutput(rot3d_2.Geometry)  # Car-Env
