# Grasshopper definition envelope2.gh (Grasshopper 0.9.76)

crv = Curve(<curve referenced from the Rhino model>)
crv_2 = Curve(<curve referenced from the Rhino model>)
crv_3 = Curve(<curve referenced from the Rhino model>)
pframes = PerpFrames(Curve=crv, Count=10, Align=True)  # -> Frames, Parameters
pframes_2 = PerpFrames(Curve=crv_3, Count=10, Align=True)  # -> Frames, Parameters
pframes_3 = PerpFrames(Curve=crv_2, Count=1, Align=True)  # -> Frames, Parameters
pi = Pi(Factor="-0.5")
pi_2 = Pi(Factor="0")
pi_3 = Pi(Factor="-0.5")
prot = RotatePlane(Plane=pframes.Frames, Angle=pi)
prot_2 = RotatePlane(Plane=pframes_2.Frames, Angle=pi_2)
prot_3 = RotatePlane(Plane=pframes_3.Frames, Angle=pi_3)
cluster = Cluster(P=prot_3, rs="0", re="0", ci="0", ce="0")
cluster_2 = Cluster(P=prot, rs="0", re="-500", ci="0", ce="25")
cluster_3 = Cluster(P=prot_2, rs="-500", re="-500", ci="25", ce="25")

# ==== cluster Cluster
number_slider = Slider(0, range=0..1000)
number_slider_2 = Slider(-1000, range=-1000..1000)
rs = ClusterInput()  # Initial Radius
re = ClusterInput()  # End Radius
ci = ClusterInput()  # Initial Cant
ce = ClusterInput()  # End Cant
num = Number(ci)
num_2 = Number(ce)
addition = Addition(A=rs, B=re)
equals = Equality(FirstNumber=rs, SecondNumber="0")  # -> Equality, Inequality
equals_2 = Equality(FirstNumber=re, SecondNumber="0")  # -> Equality, Inequality
P = ClusterInput()  # input plane
subtraction = Subtraction(A=num_2, B=num)
cull = CullPattern(List=rs, CullPattern=equals.Inequality)
cull_2 = CullPattern(List=rs, CullPattern=equals.Equality)
cull_3 = CullPattern(List=re, CullPattern=equals_2.Inequality)
cull_4 = CullPattern(List=re, CullPattern=equals_2.Equality)
pln = Plane(graft(P))
lng = ListLength(List=flatten(pln))
subtraction_2 = Subtraction(A=lng, B="1")
division = Division(A=subtraction, B=subtraction_2)
division_2 = Division(A="24500", B=cull)
division_3 = Division(A="24500", B=cull_3)
addition_2 = Addition(A=subtraction_2, B="1")
series = Series(Start=num, Step=division, Count=addition_2)  # -> graft(Series)
num_3 = Number([division_2, cull_2])
num_4 = Number([cull_4, division_3])
number_slider_3 = Slider(255, range=0..500)
subtraction_3 = Subtraction(A=num_4, B=num_3)
concat = Concatenate(FragmentA="cant: ", FragmentB=series)
Z = UnitZ(Factor=Slider(1381, range=0..10000))
division_4 = Division(A=subtraction_3, B=subtraction_2)
abs = Absolute(Value=division_4)
series_2 = Series(Start=0, Step=abs, Count=addition_2)  # -> graft(Series)
neg = Negative(Value=series_2)
addition_3 = Addition(A="-1135", B=neg)
addition_4 = Addition(A="-1440", B=neg)
addition_5 = Addition(A="-1555", B=neg)
prot = RotatePlane(Plane=pln, Angle="Pi")
division_5 = Division(A="1067", B="2")
division_6 = Division(A="-1067", B="2")
deplane = DeconstructPlane(Plane=pln)  # -> Origin, XAxis, YAxis, ZAxis
rev = Reverse(Vector=deplane.XAxis)
pt = ConstructPoint(XCoordinate=addition_4, YCoordinate="1050", ZCoordinate=0)
pt_2 = ConstructPoint(XCoordinate=addition_5, YCoordinate="1050", ZCoordinate=0)
pt_3 = ConstructPoint(XCoordinate=addition_5, YCoordinate="3333.086034", ZCoordinate=0)
pt_4 = ConstructPoint(XCoordinate=addition_4, YCoordinate="355", ZCoordinate=0)
pt_5 = ConstructPoint(XCoordinate="-1555", YCoordinate="3333.086034", ZCoordinate=0)
pt_6 = ConstructPoint(XCoordinate=addition_3, YCoordinate="75", ZCoordinate=0)
pt_7 = Point(<point referenced from the Rhino model>)
pt_8 = ConstructPoint(XCoordinate=division_6, YCoordinate=0, ZCoordinate=0)
pt_9 = ConstructPoint(XCoordinate=division_5, YCoordinate=series, ZCoordinate=0)
Z_2 = UnitZ(Factor=1)
pl = ConstructPlane(Origin=deplane.Origin, XAxis=rev, YAxis=deplane.YAxis)
move = Move(Geometry=pl, Motion=Z)  # -> Geometry, Transform
tag = TextTag3D(Location=move.Geometry, Text=concat, Size=number_slider_3, Justification=5)
orient = Orient(Geometry=Z_2, Source=PlaneXY(0, 0, 0), Target=pl)  # -> Geometry, Transform
orient_2 = Orient(Geometry=pt_9, Source=PlaneXY(0, 0, 0), Target=pl)  # -> Geometry, Transform
orient_3 = Orient(Geometry=pt_8, Source=PlaneXY(0, 0, 0), Target=pl)  # -> Geometry, Transform
orient_4 = Orient(Geometry=pt_6, Source=PlaneXY(0, 0, 0), Target=pl)  # -> Geometry, Transform
orient_5 = Orient(Geometry=pt_4, Source=PlaneXY(0, 0, 0), Target=pl)  # -> Geometry, Transform
orient_6 = Orient(Geometry=pt, Source=PlaneXY(0, 0, 0), Target=pl)  # -> Geometry, Transform
orient_7 = Orient(Geometry=pt_2, Source=PlaneXY(0, 0, 0), Target=pl)  # -> Geometry, Transform
orient_8 = Orient(Geometry=pt_3, Source=PlaneXY(0, 0, 0), Target=pl)  # -> Geometry, Transform
orient_9 = Orient(Geometry=pt_5, Source=PlaneXY(0, 0, 0), Target=pl)  # -> Geometry, Transform
orient_10 = Orient(Geometry=pt_7, Source=PlaneXY(0, 0, 0), Target=pl)  # -> Geometry, Transform
vec2pt = Vector2Pt(PointA=orient_3.Geometry, PointB=orient_2.Geometry, Unitize=False)  # -> Vector, Length
rot3d = Rotate3D(Geometry=pln, Angle=1.570796327, Center=deplane.Origin, Axis=deplane.YAxis)  # -> Geometry, Transform
mirror = Mirror(Geometry=orient_4.Geometry, Plane=rot3d.Geometry)  # -> Geometry, Transform
mirror_2 = Mirror(Geometry=orient_5.Geometry, Plane=rot3d.Geometry)  # -> Geometry, Transform
mirror_3 = Mirror(Geometry=orient_6.Geometry, Plane=rot3d.Geometry)  # -> Geometry, Transform
mirror_4 = Mirror(Geometry=orient_7.Geometry, Plane=rot3d.Geometry)  # -> Geometry, Transform
aligndim = AlignedDimension(
    Plane=pl,
    PointA=orient_7.Geometry,
    PointB=mirror_4.Geometry,
    Offset=Slider(1000, range=0..3000),
    Text="{0:0.0}",
    Size=number_slider_3)
mirror_5 = Mirror(Geometry=orient_8.Geometry, Plane=rot3d.Geometry)  # -> Geometry, Transform
mirror_6 = Mirror(Geometry=orient_9.Geometry, Plane=rot3d.Geometry)  # -> Geometry, Transform
mirror_7 = Mirror(Geometry=orient_3.Geometry, Plane=rot3d.Geometry)  # -> Geometry, Transform
vec2pt_2 = Vector2Pt(PointA=orient_3.Geometry, PointB=mirror_7.Geometry, Unitize=False)  # -> Vector, Length
expression = Expression(x=addition, Expression="if(x≤0,0,1)")
angle = Angle(VectorA=vec2pt_2.Vector, VectorB=vec2pt.Vector)  # -> Angle, Reflex
expression_2 = Expression(x=addition, y=angle.Angle, Expression="if(x≥0,y,-y)")
arc = Arc3Pt(PointA=mirror_6.Geometry, PointB=orient_10.Geometry, PointC=orient_9.Geometry)  # -> Arc, Plane, Radius
pline = PolyLine(
    Vertices=[orient_9.Geometry, orient_8.Geometry, orient_7.Geometry, orient_6.Geometry, orient_5.Geometry, orient_4.Geometry, mirror.Geometry, mirror_2.Geometry, mirror_3.Geometry, mirror_4.Geometry, mirror_5.Geometry, mirror_6.Geometry],
    Closed=False)
item = ListItem(List=[orient_3.Geometry, mirror_7.Geometry], Index=expression, Wrap=True)
join = JoinCurves(Curves=[pline, arc.Arc], Preserve=False)
rot3d_2 = Rotate3D(Geometry=join, Angle=expression_2, Center=item, Axis=orient.Geometry)  # -> Geometry, Transform
geo = Geometry(rot3d_2.Geometry)
G = ClusterOutput(geo)  # G
