# Grasshopper definition envelope3.gh (Grasshopper 0.9.76)

crv = Curve(<curve referenced from the Rhino model>)
crv_2 = Curve(<curve referenced from the Rhino model>)
crv_3 = Curve(<curve referenced from the Rhino model>)
crv_4 = Curve(<curve referenced from the Rhino model>)
crv_5 = Curve(<curve referenced from the Rhino model>)
cluster = Cluster_2(R_2="0", cant_2="0", crv=crv, R="0", cant="0")  # -> B, S
cluster_2 = Cluster_2(R_2="0", cant_2="0", crv=crv_2, R="3300", cant="20")  # -> B, S
cluster_3 = Cluster_2(R_2="3300", cant_2="20", crv=crv_3, R="3300", cant="20")  # -> B, S
cluster_4 = Cluster_2(R_2="3300", cant_2="20", crv=crv_4, R="0", cant="0")  # -> B, S
cluster_5 = Cluster_2(R_2="0", cant_2="0", crv=crv_5, R="0", cant="0")  # -> B, S
brep = Brep(cluster.B)
brep_2 = Brep(cluster_2.B)
brep_3 = Brep(cluster_3.B)
brep_4 = Brep(cluster_4.B)
brep_5 = Brep(cluster_5.B)
crv_6 = Curve(<curve referenced from the Rhino model>)
crv_7 = Curve(<curve referenced from the Rhino model>)
crv_8 = Curve(<curve referenced from the Rhino model>)
crv_9 = Curve(<curve referenced from the Rhino model>)
crv_10 = Curve(<curve referenced from the Rhino model>)
crv_11 = Curve(<curve referenced from the Rhino model>)
crv_12 = Curve(<curve referenced from the Rhino model>)
crv_13 = Curve(<curve referenced from the Rhino model>)
crv_14 = Curve(<curve referenced from the Rhino model>)
cluster_6 = Cluster_2(R_2="0", cant_2="0", crv=crv_6, R="0", cant="0")  # -> B, S
cluster_7 = Cluster_2(R_2="0", cant_2="0", crv=crv_7, R="-500", cant="25")  # -> B, S
cluster_8 = Cluster_2(R_2="-500", cant_2="25", crv=crv_8, R="-500", cant="25")  # -> B, S
cluster_9 = Cluster_2(R_2="-500", cant_2="25", crv=crv_9, R="0", cant="0")  # -> B, S
cluster_10 = Cluster_2(R_2="0", cant_2="0", crv=crv_10, R="0", cant="0")  # -> B, S
cluster_11 = Cluster_2(R_2="0", cant_2="0", crv=crv_11, R="-1250", cant="10")  # -> B, S
cluster_12 = Cluster_2(R_2="-1250", cant_2="10", crv=crv_12, R="-1250", cant="10")  # -> B, S
cluster_13 = Cluster_2(R_2="-1250", cant_2="10", crv=crv_13, R="0", cant="0")  # -> B, S
cluster_14 = Cluster_2(R_2="0", cant_2="0", crv=crv_14, R="0", cant="0")  # -> B, S
geo = Geometry(cluster_6.S)
brep_6 = Brep(cluster_6.B)
brep_7 = Brep(cluster_7.B)
geo_2 = Geometry(cluster_7.S)
brep_8 = Brep(cluster_8.B)
geo_3 = Geometry(cluster_8.S)
brep_9 = Brep(cluster_9.B)
geo_4 = Geometry(cluster_9.S)
brep_10 = Brep(cluster_10.B)
geo_5 = Geometry(cluster_10.S)
brep_11 = Brep(cluster_11.B)
geo_6 = Geometry(cluster_11.S)
brep_12 = Brep(cluster_12.B)
geo_7 = Geometry(cluster_12.S)
brep_13 = Brep(cluster_14.B)
brep_14 = Brep(cluster_13.B)
geo_8 = Geometry(cluster_14.S)
geo_9 = Geometry(cluster_13.S)
crv_15 = Curve(<curve referenced from the Rhino model>)
crv_16 = Curve(<curve referenced from the Rhino model>)
crv_17 = Curve(<curve referenced from the Rhino model>)
crv_18 = Curve(<curve referenced from the Rhino model>)
crv_19 = Curve(<curve referenced from the Rhino model>)
crv_20 = Curve(<curve referenced from the Rhino model>)
crv_21 = Curve(<curve referenced from the Rhino model>)
crv_22 = Curve(<curve referenced from the Rhino model>)
crv_23 = Curve(<curve referenced from the Rhino model>)
cluster_15 = Cluster_2(R_2="0", cant_2="0", crv=crv_15, R="0", cant="0")  # -> B, S
cluster_16 = Cluster_2(R_2="0", cant_2="0", crv=crv_16, R="-1250", cant="20")  # -> B, S
cluster_17 = Cluster_2(R_2="-1250", cant_2="20", crv=crv_17, R="-1250", cant="20")  # -> B, S
cluster_18 = Cluster_2(R_2="-1250", cant_2="20", crv=crv_18, R="0", cant="0")  # -> B, S
cluster_19 = Cluster_2(R_2="0", cant_2="0", crv=crv_19, R="0", cant="0")  # -> B, S
cluster_20 = Cluster_2(R_2="0", cant_2="0", crv=crv_20, R="-3300", cant="20")  # -> B, S
cluster_21 = Cluster_2(R_2="-3300", cant_2="20", crv=crv_21, R="-3300", cant="20")  # -> B, S
cluster_22 = Cluster_2(R_2="-3300", cant_2="20", crv=crv_22, R="0", cant="0")  # -> B, S
cluster_23 = Cluster_2(R_2="0", cant_2="0", crv=crv_23, R="0", cant="0")  # -> B, S
geo_10 = Geometry(cluster_15.S)
geo_11 = Geometry(cluster_16.S)
geo_12 = Geometry(cluster_17.S)
geo_13 = Geometry(cluster_18.S)
geo_14 = Geometry(cluster_20.S)
geo_15 = Geometry(cluster_19.S)
geo_16 = Geometry(cluster_21.S)
geo_17 = Geometry(cluster_22.S)
geo_18 = Geometry(cluster_23.S)
crv_24 = Curve(<curve referenced from the Rhino model>)
crv_25 = Curve(<curve referenced from the Rhino model>)
crv_26 = Curve(<curve referenced from the Rhino model>)
crv_27 = Curve(<curve referenced from the Rhino model>)
crv_28 = Curve(<curve referenced from the Rhino model>)
crv_29 = Curve(<curve referenced from the Rhino model>)
crv_30 = Curve(<curve referenced from the Rhino model>)
crv_31 = Curve(<curve referenced from the Rhino model>)
crv_32 = Curve(<curve referenced from the Rhino model>)
cluster_24 = Cluster_2(R_2="0", cant_2="0", crv=crv_24, R="0", cant="0")  # -> B, S
cluster_25 = Cluster_2(R_2="0", cant_2="0", crv=crv_25, R="-500", cant="25")  # -> B, S
cluster_26 = Cluster_2(R_2="-500", cant_2="25", crv=crv_26, R="-500", cant="25")  # -> B, S
cluster_27 = Cluster_2(R_2="-500", cant_2="25", crv=crv_27, R="0", cant="0")  # -> B, S
cluster_28 = Cluster_2(R_2="0", cant_2="0", crv=crv_28, R="0", cant="0")  # -> B, S
cluster_29 = Cluster_2(R_2="0", cant_2="0", crv=crv_29, R="-500", cant="25")  # -> B, S
cluster_30 = Cluster_2(R_2="-500", cant_2="25", crv=crv_30, R="-500", cant="25")  # -> B, S
cluster_31 = Cluster_2(R_2="-500", cant_2="25", crv=crv_31, R="0", cant="0")  # -> B, S
cluster_32 = Cluster_2(R_2="0", cant_2="0", crv=crv_32, R="0", cant="0")  # -> B, S
geo_19 = Geometry(cluster_24.S)
geo_20 = Geometry(cluster_25.S)
geo_21 = Geometry(cluster_26.S)
geo_22 = Geometry(cluster_27.S)
geo_23 = Geometry(cluster_28.S)
geo_24 = Geometry(cluster_29.S)
geo_25 = Geometry(cluster_30.S)
geo_26 = Geometry(cluster_32.S)
geo_27 = Geometry(cluster_31.S)

# ==== cluster Cluster_2
crv = ClusterInput()
crv_2 = Curve(crv)
divide = DivideCurve(Curve=crv_2, Count=1, Kinks=False)  # -> Points, Tangents, Parameters
move = Move(Geometry=divide.Points, Motion=divide.Tangents)  # -> Geometry, Transform
rot3d = Rotate3D(Geometry=move.Geometry, Angle=-1.570796327, Center=divide.Points, Axis=Vector(0, 0, 1))  # -> Geometry, Transform
R = ClusterInput()
cant = ClusterInput()
vec2pt = Vector2Pt(PointA=divide.Points, PointB=rot3d.Geometry, Unitize=False)  # -> Vector, Length
R_2 = ClusterInput()
cant_2 = ClusterInput()
cluster = Cluster(num=R, num_4=cant)
Z = UnitZ(Factor=1)
cluster_2 = Cluster(num=R_2, num_4=cant_2)
crv_3 = Curve(cluster)
pl = ConstructPlane(Origin=divide.Points, XAxis=vec2pt.Vector, YAxis=Z)
crv_4 = Curve(cluster_2)
item = ListItem(List=pl, Index=0, Wrap=True)
item_2 = ListItem(List=pl, Index=1, Wrap=True)
orient = Orient(Geometry=crv_4, Source=PlaneXY(0, 0, 0), Target=item)  # -> Geometry, Transform
orient_2 = Orient(Geometry=crv_3, Source=PlaneXY(0, 0, 0), Target=item_2)  # -> Geometry, Transform
swp1 = Sweep1(Rail=crv_2, Sections=[orient.Geometry, orient_2.Geometry], Miter=1)
cap = CapHoles(Brep=swp1)
geo = Geometry(swp1)
B = ClusterOutput(cap)
S = ClusterOutput(geo)  # S

# ==== cluster Cluster
num = ClusterInput()
num_2 = Number(num)
equals = Equality(FirstNumber=num_2, SecondNumber=0)  # -> Equality, Inequality
cull = CullPattern(List="0", CullPattern=equals.Equality)
cull_2 = CullPattern(List=num_2, CullPattern=equals.Inequality)
division = Division(A=24500, B=cull_2)
abs = Absolute(Value=division)
num_3 = Number([abs, cull])
X = UnitX(Factor=1)
pt = Point(<point referenced from the Rhino model>)
addition = Addition(A="1210", B=num_3)
addition_2 = Addition(A="1575", B=num_3)
addition_3 = Addition(A="1900", B=num_3)
move = Move(Geometry=pt, Motion=X)  # -> Geometry, Transform
軌距 = Panel("1067")
pdecon = Deconstruct(Point=move.Geometry)  # -> XComponent, YComponent, ZComponent
pt_2 = ConstructPoint(XCoordinate=addition_2, YCoordinate="305", ZCoordinate=0)
pt_3 = ConstructPoint(XCoordinate=addition, YCoordinate=0, ZCoordinate=0)
pt_4 = ConstructPoint(XCoordinate=addition_2, YCoordinate="1150", ZCoordinate=0)
pt_5 = ConstructPoint(XCoordinate=addition_3, YCoordinate="1150", ZCoordinate=0)
pt_6 = ConstructPoint(XCoordinate=addition_3, YCoordinate=pdecon.YComponent, ZCoordinate=0)
pt_7 = ConstructPoint(XCoordinate=0, YCoordinate="4500", ZCoordinate=0)
neg = Negative(Value=軌距)
division_2 = Division(A=軌距, B=2)
division_3 = Division(A=neg, B=2)
mirror = Mirror(Geometry=pt_3, Plane=PlaneYZ(0, 0, 0))  # -> Geometry, Transform
mirror_2 = Mirror(Geometry=pt_2, Plane=PlaneYZ(0, 0, 0))  # -> Geometry, Transform
mirror_3 = Mirror(Geometry=pt_4, Plane=PlaneYZ(0, 0, 0))  # -> Geometry, Transform
mirror_4 = Mirror(Geometry=pt_5, Plane=PlaneYZ(0, 0, 0))  # -> Geometry, Transform
mirror_5 = Mirror(Geometry=pt_6, Plane=PlaneYZ(0, 0, 0))  # -> Geometry, Transform
mirror_6 = Mirror(Geometry=move.Geometry, Plane=PlaneYZ(0, 0, 0))  # -> Geometry, Transform
pt_8 = ConstructPoint(XCoordinate=division_2, YCoordinate=0, ZCoordinate=0)
pt_9 = ConstructPoint(XCoordinate=division_3, YCoordinate=0, ZCoordinate=0)
num_4 = ClusterInput()
vec2pt = Vector2Pt(PointA=pt_9, PointB=pt_8, Unitize=False)  # -> Vector, Length
pline = PolyLine(
    Vertices=[move.Geometry, pt_6, pt_5, pt_4, pt_2, pt_3, mirror.Geometry, mirror_2.Geometry, mirror_3.Geometry, mirror_4.Geometry, mirror_5.Geometry, mirror_6.Geometry],
    Closed=False)
arc = Arc3Pt(PointA=move.Geometry, PointB=pt_7, PointC=mirror_6.Geometry)  # -> Arc, Plane, Radius
num_5 = Number(num_4)
devec = DeconstructVector(Vector=vec2pt.Vector)  # -> XComponent, YComponent, ZComponent
join = JoinCurves(Curves=[pline, arc.Arc], Preserve=False)
vec = VectorXYZ(XComponent=devec.XComponent, YComponent=num_5, ZComponent=0)  # -> Vector, Length
expression = Expression(x=num_2, y=pt_8, z=pt_9, Expression="if(x<0,-y,y)")
angle = Angle(VectorA=vec2pt.Vector, VectorB=vec.Vector)  # -> Angle, Reflex
expression_2 = Expression(x=num_2, y=angle.Angle, Expression="if(x<0,y,-y)")
rot3d = Rotate3D(Geometry=join, Angle=expression_2, Center=expression, Axis=Vector(0, 0, 1))  # -> Geometry, Transform
G = ClusterOutput(rot3d.Geometry)
